# Grasshopper definition View_to_the_Outdoors_Through_a_Facade.gh (Grasshopper 1.0.7)

ladybug = Ladybug_Ladybug()  # -> Vviiiiiiiiiizzz; plug-in component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

facade_geometry3 = Brep([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])
# Facade
# Options
facade_geometry1 = Brep([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])
facade_geometry2 = Brep([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])

# ---- group: Run View Analysis
toggle = BooleanToggle(False)

# ----
grid_size = Panel("0.25")
# Other
# Inputs
opaque_geometry = Brep(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)
test_surface = Brep(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)

facade_geometry = Brep(facade_geometry3)
edges = BrepEdges(Brep=[opaque_geometry, test_surface, facade_geometry])  # -> Naked, Interior, NonManifold

# ----
# Run the Study
viewanalysis = Ladybug_ViewAnalysis(
    geometry=flatten(test_surface),
    context=flatten([opaque_geometry, facade_geometry]),
    gridSize=grid_size,
    disFromBase="0.05",
    viewTypeOrPoints=flatten("1"),
    viewResolution=flatten("2"),
    parallel=Toggle(True),
    runIt=toggle)  # -> readMe, contextMesh, analysisMesh, testPts, testVec, viewVec, port, viewStudyResult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; plug-in component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

# ----
# Determine the Floor Area with a Quality View
meshselector = Ladybug_MeshThresholdSelector(inputMesh=viewanalysis.viewStudyMesh, analysisResult=flatten(viewanalysis.viewStudyResult), levelOfPerform="2")  # -> readMe, totalValue, areaMeetsThresh, newColoredMesh, newMeshOutline; plug-in component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
area_with_a_quality_view_m2 = Panel(meshselector.areaMeetsThresh)

# ----
# Visualize
# View Vectors
panel = Panel("10,0,0")
vdis = VectorDisplay(Anchor=panel, Vector=viewanalysis.viewVec)
